# Grasshopper definition GH_tower.gh (Grasshopper 1.0.7)

# ---- group: RH_OUT:context
mesh = Mesh([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])

# ---- group: TOWER / RH_IN:count
number_of_floors = Slider(25, range=5..25)

# ---- group: TOWER / RH_IN:height
floor_height = Slider(3.5, range=3..4.5)

# ---- group: TOWER
number_slider = Slider(-30, range=-40..21)
vector_xyz = VectorXYZ(XComponent=number_slider, YComponent=number_slider, ZComponent=0)  # -> Vector, Length
rectangle = Rectangle(Plane=PlaneXY(0, 0, 0), XSize="20", YSize="20", Radius=0)  # -> Rectangle, Length
move = Move(Geometry=rectangle.Rectangle, Motion=vector_xyz.Vector)  # -> Geometry, Transform
rotate = Rotate(Geometry=move.Geometry, Angle=degrees(Slider(63.245, range=0..100)), Plane=PlaneXY(0, 0, 0))  # -> Geometry, Transform
series = Series(Start=0, Step=floor_height, Count=number_of_floors)
unit_z = UnitZ(Factor=series)
move_2 = Move(Geometry=rotate.Geometry, Motion=unit_z)  # -> Geometry, Transform

# ---- group: TWIST / RH_IN:rotation
rotation = Slider(36, range=0..45)

# ---- group: TWIST
list_length = ListLength(List=move_2.Geometry)
area = Area(Geometry=move_2.Geometry)  # -> Area, Centroid
range = Range(Domain=Domain(0, 1), Steps=expr("x-1", list_length))
graph_mapper = GraphMapper(range, x0=0, x1=1, y0=0, y1=1, container_name="Bezier", cpx=[0, 0.7642779946, 0, 1], cpy=[0, 0, 1, 1])
panel = Panel("0")

# ----
construct_domain = ConstructDomain(DomainStart=panel, DomainEnd=rotation)
bounds = Bounds(Numbers=graph_mapper)
remap_numbers = RemapNumbers(Value=graph_mapper, Source=bounds, Target=construct_domain)  # -> Mapped, Clipped

# ---- group: TWIST (continued)
rotate_2 = Rotate(Geometry=move_2.Geometry, Angle=degrees(remap_numbers.Mapped), Plane=area.Centroid)  # -> Geometry, Transform

# ----
loft = Loft(
    Curves=rotate_2.Geometry,
    Options={Adjust=False, Closed=False, LoftEnds=0, LoftSimp=0, LoftType=0, Rebuild=10, Refit=0.01})
cap_holes = CapHoles(Brep=loft)
preview = CustomPreview(Geometry=rotate_2.Geometry, Material=ColourSwatch(SwatchColor=RGB(0, 0, 0)))
mesh_brep = MeshBrep(
    Brep=cap_holes,
    Settings={GridMaxCount=0, GridMinCount=16, JaggedSeams=False, MaxEdgeLength=0, MinEdgeLength=0.0001, MinTolerance=0, Refine=True, RefineAngle=0, RelativeTolerance=0.65, SimplePlanes=True, Tolerance=0})

# ---- group: RH_OUT:mesh
mesh_2 = Mesh(mesh_brep)

# ---- group: RH_OUT:edges
curve = Curve(rotate_2.Geometry)

# ----
preview_2 = CustomPreview(Geometry=mesh_brep, Material=ColourSwatch(SwatchColor=RGB(174, 248, 255)))
